% Simulink data dictionary test.sldd

code = Simulink.ConfigSet(StartTime="0", StopTime="10", Solver="FixedStepDiscrete", ProdHWDeviceType="Intel->x86-64 (Windows64)", SystemTargetFile="ert.tlc", TargetLang="C++")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

State = Simulink.Bus()
  position: double
  velocity: double

TsSensors = 0.001
TsControl = 0.1